# Grasshopper definition 01.0.Shift.gh (Grasshopper 1.0.7)
# plug-ins: Bifocals

gallery = ImageGallery(CycleDelay=30, Randomize=False, UseLocalImages=True, UseRemoteImages=False)
gallery_2 = ImageGallery(CycleDelay=30, Randomize=False, UseLocalImages=True, UseRemoteImages=False)
cir = Circle(Plane=PlaneXY(0, 0, 0), Radius=Slider(27.8, range=0..100))
Z = UnitZ(Factor=Slider(40.4, range=0..100))
move = Move(Geometry=cir, Motion=Z)  # -> Geometry, Transform
number_slider = Slider(20, range=12..20)
number_slider_2 = Slider(2.8, range=0..10)
divide = DivideCurve(Curve=cir, Count=number_slider, Kinks=False)  # -> Points, Tangents, Parameters
divide_2 = DivideCurve(Curve=move.Geometry, Count=number_slider, Kinks=False)  # -> Points, Tangents, Parameters
points = PointList(Points=divide_2.Points, Size=number_slider_2)
points_2 = PointList(Points=divide.Points, Size=number_slider_2)
panel = Panel(divide_2.Points)
shift = ShiftList(List=divide_2.Points, Shift=Slider(8, range=0..10), Wrap=True)
points_3 = PointList(Points=shift, Size=number_slider_2)
ln = Line(StartPoint=divide.Points, EndPoint=shift)
panel_2 = Panel(shift)
loft_opt = LoftOptions(Closed=Toggle(True), Adjust=False, Rebuild=0, Refit=0, Type=0)
loft = Loft(Curves=ln, Options=loft_opt)

# ---- group: DefinePlane
popgeo = PopulateGeometry(Geometry=loft, Count="1", Seed=Slider(60, range=0..100))
vec = VectorXYZ(XComponent=Slider(0.3, range=0..1), YComponent=Slider(0.3, range=0..1), ZComponent=Slider(0.4, range=0..1))  # -> Vector, Length
xz = XZPlane(Origin=popgeo)
padjust = AdjustPlane(Plane=xz, Normal=vec.Vector)
sec = BrepPlane(Brep=loft, Plane=padjust)  # -> Curves, Points

# ----
srfsplit = SurfaceSplit(Surface=loft, Curves=sec.Curves)
item = ListItem(List=srfsplit, Index=0, Wrap=True)  # -> Item, Item1, Item2
swatch = ColourSwatch(SwatchColor=RGB(0, 187, 255))
preview = CustomPreview(Geometry=item.Item, Material=ColourSwatch(SwatchColor=RGB(255, 174, 0)))
preview_2 = CustomPreview(Geometry=item.Item1, Material=swatch)
preview_3 = CustomPreview(Geometry=item.Item2, Material=[swatch, ColourSwatch(SwatchColor=RGB(255, 0, 195))])
