# Grasshopper definition 02.0.Series.gh (Grasshopper 1.0.7)
# plug-ins: Bifocals

number_slider = Slider(100, range=0..100)
number_slider_2 = Slider(100, range=0..100)
cir = Circle(Plane=PlaneXY(0, 0, 0), Radius="500")
boundary = BoundarySurfaces(Edges=cir)
number_slider_3 = Slider(5, range=0..10)
number_slider_4 = Slider(100, range=0..100)
rectangle = Rectangle(Plane=PlaneXY(0, 0, 0), XSize=number_slider, YSize=number_slider, Radius=0)  # -> Rectangle, Length
number_slider_5 = Slider(100, range=0..100)
rectangle_2 = Rectangle(Plane=PlaneXY(0, 0, 0), XSize=number_slider_2, YSize=number_slider_2, Radius=0)  # -> Rectangle, Length
popgeo = PopulateGeometry(Geometry=boundary, Count=Slider(59, range=0..100), Seed=1)
explode = Explode(Curve=rectangle.Rectangle, Recursive=True)  # -> Segments, Vertices
number_slider_6 = Slider(9, range=1..20)
explode_2 = Explode(Curve=rectangle_2.Rectangle, Recursive=True)  # -> Segments, Vertices
item = ListItem(List=explode.Segments, Index=0, Wrap=True)  # -> Item, Item1, Item2, Item3
sqgrid = Square(Plane=PlaneXY(0, 0, 0), Size=number_slider_4, ExtentX=number_slider_3, ExtentY=number_slider_3)  # -> Cells, Points
hexgrid = Hexagonal(Plane=PlaneXY(0, 0, 0), Size=number_slider_4, ExtentX=number_slider_3, ExtentY=number_slider_3)  # -> Cells, Points
voronoi = Voronoi(Points=popgeo, Radius=Slider(150, range=50..150), BruteForceOverride=False)
rectangle_3 = Rectangle(Plane=PlaneXY(0, 0, 0), XSize=number_slider_5, YSize=number_slider_5, Radius=0)  # -> Rectangle, Length
item_2 = ListItem(List=explode_2.Segments, Index=0, Wrap=True)  # -> Item, Item1, Item2, Item3
number_slider_7 = Slider(0, range=0..20)

# ---- group: Branch1
divide = DivideCurve(Curve=item.Item, Count=number_slider_6, Kinks=False)  # -> Points, Tangents, Parameters

# ---- group: Branch2
divide_2 = DivideCurve(Curve=item.Item1, Count=number_slider_6, Kinks=False)  # -> Points, Tangents, Parameters

# ---- group: Branch3
divide_3 = DivideCurve(Curve=item.Item2, Count=number_slider_6, Kinks=False)  # -> Points, Tangents, Parameters

# ---- group: Branch4
divide_4 = DivideCurve(Curve=item.Item3, Count=number_slider_6, Kinks=False)  # -> Points, Tangents, Parameters

# ----
explode_3 = Explode(Curve=voronoi, Recursive=True)  # -> Segments, Vertices
number_slider_8 = Slider(7, range=1..20)
shift = ShiftList(List=explode_3.Segments, Shift=Slider(1, range=1..5), Wrap=True)

divide_5 = DivideCurve(Curve=item_2.Item, Count=10, Kinks=False)  # -> Points, Tangents, Parameters
divide_6 = DivideCurve(Curve=item_2.Item1, Count=10, Kinks=False)  # -> Points, Tangents, Parameters
shift_2 = ShiftList(List=divide_6.Points, Shift=1, Wrap=True)
ln = Line(StartPoint=divide_5.Points, EndPoint=shift_2)

divide_7 = DivideCurve(Curve=item_2.Item1, Count=10, Kinks=False)  # -> Points, Tangents, Parameters
divide_8 = DivideCurve(Curve=item_2.Item2, Count=10, Kinks=False)  # -> Points, Tangents, Parameters
shift_3 = ShiftList(List=divide_8.Points, Shift=1, Wrap=True)
ln_2 = Line(StartPoint=divide_7.Points, EndPoint=shift_3)

divide_9 = DivideCurve(Curve=item_2.Item2, Count=10, Kinks=False)  # -> Points, Tangents, Parameters
divide_10 = DivideCurve(Curve=item_2.Item3, Count=10, Kinks=False)  # -> Points, Tangents, Parameters
shift_4 = ShiftList(List=divide_10.Points, Shift=1, Wrap=True)
ln_3 = Line(StartPoint=divide_9.Points, EndPoint=shift_4)

divide_11 = DivideCurve(Curve=item_2.Item3, Count=10, Kinks=False)  # -> Points, Tangents, Parameters
divide_12 = DivideCurve(Curve=item_2.Item, Count=10, Kinks=False)  # -> Points, Tangents, Parameters
shift_5 = ShiftList(List=divide_12.Points, Shift=1, Wrap=True)
ln_4 = Line(StartPoint=divide_11.Points, EndPoint=shift_5)

shift_6 = ShiftList(List=divide_2.Points, Shift=number_slider_7, Wrap=True)
shift_7 = ShiftList(List=divide_3.Points, Shift=number_slider_7, Wrap=True)
shift_8 = ShiftList(List=divide_4.Points, Shift=number_slider_7, Wrap=True)
shift_9 = ShiftList(List=divide.Points, Shift=number_slider_7, Wrap=True)
divide_13 = DivideCurve(Curve=explode_3.Segments, Count=number_slider_8, Kinks=False)  # -> Points, Tangents, Parameters
divide_14 = DivideCurve(Curve=shift, Count=number_slider_8, Kinks=False)  # -> Points, Tangents, Parameters
ln_5 = Line(StartPoint=divide.Points, EndPoint=shift_6)
ln_6 = Line(StartPoint=divide_2.Points, EndPoint=shift_7)
ln_7 = Line(StartPoint=divide_3.Points, EndPoint=shift_8)
ln_8 = Line(StartPoint=divide_4.Points, EndPoint=shift_9)
shift_10 = ShiftList(List=divide_14.Points, Shift=Slider(0, range=0..20), Wrap=True)
ln_9 = Line(StartPoint=divide_13.Points, EndPoint=shift_10)
entwine = Entwine(Branch00=ln_5, Branch01=ln_6, Branch02=ln_7, Branch03=ln_8, FlattenInputs=True)
merge = Merge(Data1=ln_5, Data2=ln_6, Data3=ln_7, Data4=ln_8)
lng = ListLength(List=ln_9)
lng_2 = ListLength(List=entwine)
lng_3 = ListLength(List=merge)
series = Series(Start=0, Step=1, Count=lng)
series_2 = Series(Start=0, Step=1, Count=lng_2)
series_3 = Series(Start=0, Step=1, Count=lng_3)
gradient = Gradient(
    LowerLimit=0,
    UpperLimit=lng,
    Parameter=series,
    stops=[0: RGB(243, 57, 0), 0.1: RGB(236, 27, 60), 0.2: RGB(210, 0, 118), 0.3: RGB(103, 0, 120), 0.4: RGB(39, 72, 161), 0.5: RGB(1, 192, 229), 0.6: RGB(18, 178, 90), 0.7: RGB(79, 186, 8), 0.8: RGB(220, 237, 32), 0.9: RGB(247, 159, 20), 1: RGB(243, 57, 0)])
gradient_2 = Gradient(
    LowerLimit=0,
    UpperLimit=lng_2,
    Parameter=series_2,
    stops=[0: RGB(243, 57, 0), 0.1: RGB(236, 27, 60), 0.2: RGB(210, 0, 118), 0.3: RGB(103, 0, 120), 0.4: RGB(39, 72, 161), 0.5: RGB(1, 192, 229), 0.6: RGB(18, 178, 90), 0.7: RGB(79, 186, 8), 0.8: RGB(220, 237, 32), 0.9: RGB(247, 159, 20), 1: RGB(243, 57, 0)])
gradient_3 = Gradient(
    LowerLimit=0,
    UpperLimit=lng_3,
    Parameter=series_3,
    stops=[0: RGB(243, 57, 0), 0.1: RGB(236, 27, 60), 0.2: RGB(210, 0, 118), 0.3: RGB(103, 0, 120), 0.4: RGB(39, 72, 161), 0.5: RGB(1, 192, 229), 0.6: RGB(18, 178, 90), 0.7: RGB(79, 186, 8), 0.8: RGB(220, 237, 32), 0.9: RGB(247, 159, 20), 1: RGB(243, 57, 0)])
preview = CustomPreview(Geometry=entwine, Material=gradient_2)
preview_2 = CustomPreview(Geometry=ln_9, Material=gradient)
preview_3 = CustomPreview(Geometry=merge, Material=gradient_3)
