# Grasshopper definition 04.0.RandomJitter.gh (Grasshopper 1.0.7)
# plug-ins: Bifocals

number_slider = Slider(100, range=0..100)
number_slider_2 = Slider(100, range=0..100)
rectangle = Rectangle(Plane=PlaneXY(0, 0, 0), XSize=number_slider, YSize=number_slider, Radius=0)  # -> Rectangle, Length
number_slider_3 = Slider(20, range=0..100)
rectangle_2 = Rectangle(Plane=PlaneXY(0, 0, 0), XSize=number_slider_2, YSize=number_slider_2, Radius=0)  # -> Rectangle, Length
number_slider_4 = Slider(20, range=0..100)
# This definition is used for computer application course of TKU Archi EA3 and is licensed under Lee, Ching-Hang. You are free to copy, communicate and adapt the work, so long as you attribute the work in the manner specified by the author or licensor (but not in any way that suggests that they endorse you or your use of the work).
# 
# chinghanglee@hotmail.com
panel = Panel("100")
explode = Explode(Curve=rectangle.Rectangle, Recursive=True)  # -> Segments, Vertices
explode_2 = Explode(Curve=rectangle_2.Rectangle, Recursive=True)  # -> Segments, Vertices
number_slider_5 = Slider(20, range=0..100)
item = ListItem(List=explode.Segments, Index=0, Wrap=True)  # -> Item, Item1, Item2, Item3
random = Random(Range=panel, Number=number_slider_3, Seed=Slider(37, range=0..100))
random_2 = Random(Range=panel, Number=number_slider_3, Seed=2)
random_3 = Random(Range=panel, Number=number_slider_3, Seed=Slider(43, range=0..100))
random_4 = Random(Range=panel, Number=number_slider_3, Seed=2)
item_2 = ListItem(List=explode_2.Segments, Index=0, Wrap=True)  # -> Item, Item1, Item2, Item3
divide = DivideCurve(Curve=item.Item, Count=number_slider_4, Kinks=False)  # -> Points, Tangents, Parameters
divide_2 = DivideCurve(Curve=item.Item2, Count=number_slider_4, Kinks=False)  # -> Points, Tangents, Parameters
divide_3 = DivideCurve(Curve=item.Item1, Count=number_slider_4, Kinks=False)  # -> Points, Tangents, Parameters
divide_4 = DivideCurve(Curve=item.Item3, Count=number_slider_4, Kinks=False)  # -> Points, Tangents, Parameters
pt = ConstructPoint(XCoordinate=random_2, YCoordinate=0, ZCoordinate=0)
pt_2 = ConstructPoint(XCoordinate=random_3, YCoordinate=panel, ZCoordinate=0)
pt_3 = ConstructPoint(XCoordinate=0, YCoordinate=random_4, ZCoordinate=0)
pt_4 = ConstructPoint(XCoordinate=panel, YCoordinate=random, ZCoordinate=0)
jitter = Jitter(List=divide.Points, Jitter=1, Seed=2)  # -> Values, Indices
divide_5 = DivideCurve(Curve=item_2.Item, Count=number_slider_5, Kinks=False)  # -> Points, Tangents, Parameters
divide_6 = DivideCurve(Curve=item_2.Item2, Count=number_slider_5, Kinks=False)  # -> Points, Tangents, Parameters
divide_7 = DivideCurve(Curve=item_2.Item1, Count=number_slider_5, Kinks=False)  # -> Points, Tangents, Parameters
divide_8 = DivideCurve(Curve=item_2.Item3, Count=number_slider_5, Kinks=False)  # -> Points, Tangents, Parameters
jitter_2 = Jitter(List=divide_3.Points, Jitter=1, Seed=number_slider_4)  # -> Values, Indices
random_5 = Random(Range="-20 to 20", Number=number_slider_5, Seed=2)
random_6 = Random(Range="-20 to 20", Number=number_slider_5, Seed=Slider(35, range=0..100))
ln = Line(StartPoint=jitter.Values, EndPoint=divide_2.Points)
jitter_3 = Jitter(List=divide_5.Points, Jitter=1, Seed=2)  # -> Values, Indices
jitter_4 = Jitter(List=divide_7.Points, Jitter=1, Seed=2)  # -> Values, Indices
ln_2 = Line(StartPoint=jitter_2.Values, EndPoint=divide_4.Points)
ln_3 = Line(StartPoint=pt, EndPoint=pt_2)
ln_4 = Line(StartPoint=pt_3, EndPoint=pt_4)
pdecon = Deconstruct(Point=jitter_3.Values)  # -> XComponent, YComponent, ZComponent
pdecon_2 = Deconstruct(Point=divide_6.Points)  # -> XComponent, YComponent, ZComponent
pdecon_3 = Deconstruct(Point=jitter_4.Values)  # -> XComponent, YComponent, ZComponent
pdecon_4 = Deconstruct(Point=divide_8.Points)  # -> XComponent, YComponent, ZComponent
number_slider_6 = Slider(100, range=0..100)
addition = Addition(A=random_5, B=pdecon.YComponent)
addition_2 = Addition(A=random_5, B=pdecon_2.YComponent)
addition_3 = Addition(A=random_6, B=pdecon_3.XComponent)
addition_4 = Addition(A=random_6, B=pdecon_4.XComponent)
genes = GenePool(Decimals=2, Maximum=100, Minimum=0, Value=[1.113642147, 50.11030652, 62.59471321, 79.01513128])
pt_5 = ConstructPoint(XCoordinate=pdecon.XComponent, YCoordinate=addition, ZCoordinate=0)
pt_6 = ConstructPoint(XCoordinate=pdecon_2.XComponent, YCoordinate=addition_2, ZCoordinate=0)
pt_7 = ConstructPoint(XCoordinate=addition_3, YCoordinate=pdecon_3.YComponent, ZCoordinate=0)
pt_8 = ConstructPoint(XCoordinate=addition_4, YCoordinate=pdecon_4.YComponent, ZCoordinate=0)
rectangle_3 = Rectangle(Plane=PlaneXY(0, 0, 0), XSize=number_slider_6, YSize=number_slider_6, Radius=0)  # -> Rectangle, Length
ln_5 = Line(StartPoint=pt_5, EndPoint=pt_6)
ln_6 = Line(StartPoint=pt_7, EndPoint=pt_8)
explode_3 = Explode(Curve=rectangle_3.Rectangle, Recursive=True)  # -> Segments, Vertices
random_7 = Random(Range="100", Number=Slider(20, range=0..100), Seed=genes)  # -> simplify(Random)
genes_2 = GenePool(Decimals=2, Maximum=100, Minimum=0, Value=[59.67302432, 36.79055275, 72.04736875, 63.0302124])
divide_9 = DivideCurve(Curve=explode_3.Segments, Count=Slider(20, range=0..100), Kinks=False)  # -> simplify(Points), Tangents, Parameters
bang = ExplodeTree(Data=random_7)  # -> Branch0, Branch1, Branch2, Branch3
jitter_5 = Jitter(List=divide_9.Points, Jitter=1, Seed=graft(genes_2))  # -> simplify(Values), Indices
pt_9 = ConstructPoint(XCoordinate=bang.Branch0, YCoordinate=0, ZCoordinate=0)
pt_10 = ConstructPoint(XCoordinate=bang.Branch1, YCoordinate="100", ZCoordinate=0)
pt_11 = ConstructPoint(XCoordinate=0, YCoordinate=bang.Branch2, ZCoordinate=0)
pt_12 = ConstructPoint(XCoordinate="100", YCoordinate=bang.Branch3, ZCoordinate=0)
ln_7 = Line(StartPoint=pt_9, EndPoint=pt_10)
ln_8 = Line(StartPoint=pt_11, EndPoint=pt_12)
bang_2 = ExplodeTree(Data=jitter_5.Values)  # -> Branch0, Branch1, Branch2, Branch3
ln_9 = Line(StartPoint=bang_2.Branch0, EndPoint=bang_2.Branch2)
ln_10 = Line(StartPoint=bang_2.Branch1, EndPoint=bang_2.Branch3)
