# Grasshopper definition 0505_truchetBasic.gh (Grasshopper 1.0.7)
# plug-ins: Bifocals, ClipperComponents

panel = Panel("""0.5
1
1.5""")
pi = Pi(Factor=panel)
number_slider = Slider(10, range=3..10)
number_slider_2 = Slider(10, range=3..10)
item = ListItem(List=pi, Index=0, Wrap=True)  # -> Item, Item1, Item2
sqgrid = Square(Plane=PlaneXY(0, 0, 0), Size=Slider(10, range=3..20), ExtentX=number_slider_2, ExtentY=number_slider)  # -> simplify(Cells), Points

# ---- group: Unit_1
crv = Curve([<curve referenced from the Rhino model> x4])
group = Group(Objects=crv)
bbox = BoundingBox(Content=crv, Plane=PlaneXY(0, 0, 0), UnionBox=True)  # -> Box, Box_2
recmap = RectangleMapping(Geometry=group, Source=bbox.Box, Target=sqgrid.Cells)  # -> Geometry, Transform
area = Area(Geometry=sqgrid.Cells)  # -> Area, Centroid
rotate = Rotate(Geometry=recmap.Geometry, Angle=item.Item, Plane=area.Centroid)  # -> Geometry, Transform
rotate_2 = Rotate(Geometry=recmap.Geometry, Angle=item.Item1, Plane=area.Centroid)  # -> Geometry, Transform
rotate_3 = Rotate(Geometry=recmap.Geometry, Angle=item.Item2, Plane=area.Centroid)  # -> Geometry, Transform

# ---- group: Unit_2
crv_2 = Curve([<curve referenced from the Rhino model> x4])
group_2 = Group(Objects=crv_2)
bbox_2 = BoundingBox(Content=crv_2, Plane=PlaneXY(0, 0, 0), UnionBox=True)  # -> Box, Box_2
recmap_2 = RectangleMapping(Geometry=group_2, Source=bbox_2.Box, Target=sqgrid.Cells)  # -> Geometry, Transform
area_2 = Area(Geometry=sqgrid.Cells)  # -> Area, Centroid
rotate_4 = Rotate(Geometry=recmap_2.Geometry, Angle=item.Item1, Plane=area_2.Centroid)  # -> Geometry, Transform
rotate_5 = Rotate(Geometry=recmap_2.Geometry, Angle=item.Item2, Plane=area_2.Centroid)  # -> Geometry, Transform
rotate_6 = Rotate(Geometry=recmap_2.Geometry, Angle=item.Item, Plane=area_2.Centroid)  # -> Geometry, Transform

crv_3 = Curve([<curve referenced from the Rhino model> x4])
group_3 = Group(Objects=crv_3)
bbox_3 = BoundingBox(Content=crv_3, Plane=PlaneXY(0, 0, 0), UnionBox=True)  # -> Box, Box_2
recmap_3 = RectangleMapping(Geometry=group_3, Source=bbox_3.Box, Target=sqgrid.Cells)  # -> Geometry, Transform

crv_4 = Curve([<curve referenced from the Rhino model> x4])
group_4 = Group(Objects=crv_4)
bbox_4 = BoundingBox(Content=crv_4, Plane=PlaneXY(0, 0, 0), UnionBox=True)  # -> Box, Box_2
recmap_4 = RectangleMapping(Geometry=group_4, Source=bbox_4.Box, Target=sqgrid.Cells)  # -> Geometry, Transform
area_3 = Area(Geometry=sqgrid.Cells)  # -> Area, Centroid
rotate_7 = Rotate(Geometry=recmap_4.Geometry, Angle=item.Item, Plane=area_3.Centroid)  # -> Geometry, Transform
rotate_8 = Rotate(Geometry=recmap_4.Geometry, Angle=item.Item1, Plane=area_3.Centroid)  # -> Geometry, Transform
rotate_9 = Rotate(Geometry=recmap_4.Geometry, Angle=item.Item2, Plane=area_3.Centroid)  # -> Geometry, Transform

# ----
explode = Explode(Curve=sqgrid.Cells, Recursive=True)  # -> Segments, simplify(Vertices)
multiplication = Multiplication(A=number_slider_2, B=number_slider)
item_2 = ListItem(List=explode.Vertices, Index=0, Wrap=True)  # -> Item, Item1, Item2, Item3
multiplication_2 = Multiplication(A=number_slider_2, B=number_slider)
dom = ConstructDomain(DomainStart=0, DomainEnd="3")
random = Random(Range=Domain(0, 1), Number=multiplication, Seed=Slider(6.1, range=0..10), Integers=True)
ln = Line(StartPoint=item_2.Item1, EndPoint=item_2.Item3)
random_2 = Random(Range=dom, Number=multiplication_2, Seed=Slider(1.3, range=0..10), Integers=True)
blrt = Line(StartPoint=item_2.Item, EndPoint=item_2.Item2)
sift = SiftPattern(List=flatten(ln), SiftPattern=random)  # -> Output0, Output1
sift_2 = SiftPattern(List=flatten(blrt), SiftPattern=random)  # -> Output0, Output1
crv_5 = Curve([sift_2.Output1, sift.Output0])
p_n_c = PickNChoose(
    Pattern=random_2,
    Stream0=flatten(rotate.Geometry),
    Stream1=flatten(recmap_3.Geometry),
    Stream2=flatten(rotate_7.Geometry),
    Stream3=flatten(rotate_6.Geometry))
bbox_5 = BoundingBox(Content=p_n_c, Plane=PlaneXY(0, 0, 0), UnionBox=True)  # -> Box, Box_2
debrep = DeconstructBrep(Brep=bbox_5.Box)  # -> Faces, Edges, Vertices
join = JoinCurves(Curves=debrep.Edges, Preserve=False)
crv_6 = Curve([<curve referenced from the Rhino model> x4])  # disabled
series = Series(Start=0, Step=Slider(1.3, range=0..10), Count=Slider(12, range=5..20))
polyoffset = PolylineOffset(
    Polylines=graft(crv_6),
    Distance=series,
    Plane=Plane(origin=(0, 0, 0), x=(0, 0, 0), y=(0, 0, 0)),
    Tolerance=0.001,
    ClosedFillet=1,
    OpenFillet=1,
    Miter=2)  # -> Contour, simplify(Holes)
pshift = ShiftPaths(Data=polyoffset.Holes, Offset=-1)
curvepoint = PointOnCurve(pshift, parameter=0.5)
incurve = PointInCurve(Point=curvepoint, Curve=simplify(graft(crv_6)))  # -> Relationship, Point
equals = Equality(FirstNumber=incurve.Relationship, SecondNumber=0)  # -> Equality, Inequality
cull = CullPattern(List=pshift, CullPattern=equals.Inequality)
number_slider_3 = Slider(12, range=0..100)
number_slider_4 = Slider(12, range=0..100)
sqgrid_2 = Square(Plane=PlaneXY(0, 0, 0), Size=Slider(10, range=0..10), ExtentX=number_slider_4, ExtentY=number_slider_3)  # -> Cells, Points
multiplication_3 = Multiplication(A=number_slider_4, B=number_slider_3)
target = Curve(sqgrid_2.Cells)
unit1 = Curve([<curve referenced from the Rhino model> x4])
unit2 = Curve([<curve referenced from the Rhino model> x4])
unit3 = Curve([<curve referenced from the Rhino model> x4])
unit4 = Curve([<curve referenced from the Rhino model> x4])
explode_2 = Explode(Curve=sqgrid_2.Cells, Recursive=True)  # -> Segments, Vertices
group_5 = Group(Objects=unit1)
group_6 = Group(Objects=unit2)
group_7 = Group(Objects=unit3)
group_8 = Group(Objects=unit4)
item_3 = ListItem(List=explode_2.Vertices, Index=0, Wrap=True)  # -> Item, Item1, Item2, Item3
bbox_6 = BoundingBox(Content=group_5, Plane=PlaneXY(0, 0, 0), UnionBox=False)  # -> Box, Box_2
bbox_7 = BoundingBox(Content=group_6, Plane=PlaneXY(0, 0, 0), UnionBox=False)  # -> Box, Box_2
bbox_8 = BoundingBox(Content=group_7, Plane=PlaneXY(0, 0, 0), UnionBox=False)  # -> Box, Box_2
bbox_9 = BoundingBox(Content=group_8, Plane=PlaneXY(0, 0, 0), UnionBox=False)  # -> Box, Box_2
ln_2 = Line(StartPoint=item_3.Item, EndPoint=item_3.Item2)  # -> flatten(Line)
ln_3 = Line(StartPoint=item_3.Item1, EndPoint=item_3.Item3)  # -> flatten(Line)
random_3 = Random(Range="0 to 3", Number=multiplication_3, Seed=Slider(5.5, range=0..10), Integers=True)
recmap_5 = RectangleMapping(Geometry=group_5, Source=bbox_6.Box, Target=target)  # -> Geometry, Transform
recmap_6 = RectangleMapping(Geometry=group_6, Source=bbox_7.Box, Target=target)  # -> Geometry, Transform
recmap_7 = RectangleMapping(Geometry=group_7, Source=bbox_8.Box, Target=target)  # -> Geometry, Transform
recmap_8 = RectangleMapping(Geometry=group_8, Source=bbox_9.Box, Target=target)  # -> Geometry, Transform
lng = ListLength(List=ln_2)
random_4 = Random(Range=Domain(0, 1), Number=lng, Seed=Slider(1.6, range=0..10), Integers=True)
dispatch = Dispatch(List=ln_2, DispatchPattern=random_4)  # -> ListA, ListB
dispatch_2 = Dispatch(List=ln_3, DispatchPattern=random_4)  # -> ListA, ListB
p_n_c_2 = PickNChoose(
    Pattern=random_3,
    Stream0=flatten(recmap_5.Geometry),
    Stream1=flatten(recmap_6.Geometry),
    Stream2=flatten(recmap_7.Geometry),
    Stream3=flatten(recmap_8.Geometry))
crv_7 = Curve([dispatch.ListA, dispatch_2.ListB])
