# Grasshopper definition 0506_morph.gh (Grasshopper 1.0.7)
# plug-ins: Bifocals

srf = Surface(reparameterize(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))
geo = Geometry(<brep referenced from the Rhino model>)
unit = Geometry(geo)
srf_2 = Surface(srf)
bbox = BoundingBox(Content=unit, Plane=PlaneXY(0, 0, 0))  # -> Box, Box_2
divide = DivideDomain²(Domain=srf_2, UCount=Slider(7, range=0..10), VCount=Slider(4, range=0..10))
debrep = DeconstructBrep(Brep=bbox.Box)  # -> Faces, Edges, Vertices
md_slider = MDSlider(SliderMode=0, slider_value=Point(0.5, 0.5, 0.5), x_domain=Domain(0, 1), y_domain=Domain(0, 1), z_domain=Domain(0, 1))
md_slider_2 = MDSlider(SliderMode=0, slider_value=Point(0.5, 0.5, 0.5), x_domain=Domain(0, 1), y_domain=Domain(0, 1), z_domain=Domain(0, 1))
item = ListItem(List=debrep.Faces, Index="4", Wrap=True)
subsrf = Isotrim(Surface=srf_2, Domain=divide)
sbox = SurfaceBox(Surface=srf_2, Domain=divide, Height=Slider(5, range=0..10))
sporph = Sporph(G=unit, S0=reparameterize(item), P0=md_slider, S1=reparameterize(subsrf), P1=md_slider_2, R=False)  # disabled
srfmorph = SurfaceMorph(Geometry=unit, Reference=bbox.Box, Surface=reparameterize(subsrf), UDomain="1", VDomain="1", WDomain="5")  # disabled
morph = BoxMorph(Geometry=unit, Reference=bbox.Box, Target=sbox)  # disabled
