# Grasshopper definition 0506_panel.gh (Grasshopper 1.0.7)
# plug-ins: Bifocals

srf = Surface(reparameterize(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))
number_slider = Slider(3, range=0..10)
divide = DivideDomain²(Domain=srf, UCount=Slider(8, range=0..10), VCount=Slider(9, range=0..10))
subsrf = Isotrim(Surface=srf, Domain=divide)
debrep = DeconstructBrep(Brep=subsrf)  # -> Faces, Edges, Vertices
popgeo = PopulateGeometry(Geometry=srf, Count=number_slider, Seed=number_slider)
item = ListItem(List=debrep.Vertices, Index=0, Wrap=True)  # -> Item, Item1, Item2, Item3
srf4pt = _4PointSurface(CornerA=item.Item, CornerB=item.Item1, CornerC=item.Item2)
srf4pt_2 = _4PointSurface(CornerA=item.Item, CornerB=item.Item2, CornerC=item.Item3)
debrep_2 = DeconstructBrep(Brep=srf4pt)  # -> Faces, Edges, Vertices
area = Area(Geometry=srf4pt)  # -> Area, Centroid
debrep_3 = DeconstructBrep(Brep=srf4pt_2)  # -> Faces, Edges, Vertices
area_2 = Area(Geometry=srf4pt_2)  # -> Area, Centroid
nurbs = NurbsCurve(Vertices=debrep_2.Vertices, Degree=3, Periodic=invert(False))  # -> Curve, Length, Domain
nurbs_2 = NurbsCurve(Vertices=debrep_3.Vertices, Degree=3, Periodic=invert(False))  # -> Curve, Length, Domain
pull = PullPoint(Point=area.Centroid, Geometry=popgeo, ClosestOnly=True)  # -> ClosestPoint, Distance
bnd = Bounds(Numbers=flatten(pull.Distance))
dom = ConstructDomain(DomainStart=Slider(0.1, range=0.1..0.9), DomainEnd=Slider(0.7, range=0.1..0.9))
remap = RemapNumbers(Value=pull.Distance, Source=bnd, Target=dom)  # -> Mapped, Clipped
scale = Scale(Geometry=nurbs.Curve, Center=area.Centroid, Factor=remap.Mapped)  # -> simplify(Geometry), Transform
scale_2 = Scale(Geometry=nurbs_2.Curve, Center=area_2.Centroid, Factor=remap.Mapped)  # -> simplify(Geometry), Transform
join = JoinCurves(Curves=debrep_2.Edges, Preserve=False)  # -> simplify(Curves)
join_2 = JoinCurves(Curves=debrep_3.Edges, Preserve=False)  # -> simplify(Curves)
boundary = BoundarySurfaces(Edges=[join_2, scale_2.Geometry])
boundary_2 = BoundarySurfaces(Edges=[join, scale.Geometry])

merge = Merge(Data1=boundary_2, Data2=boundary)  # -> flatten(Result)
md_slider = MDSlider(SliderMode=0, slider_value=Point(0.5, 0.5, 0.5), x_domain=Domain(0, 1), y_domain=Domain(0, 1), z_domain=Domain(0, 1))
evalsrf = EvaluateSurface(Surface=reparameterize(merge), Point=md_slider)  # -> Point, Normal, UDirection, VDirection, Frame
recgrid = Rectangular(
    Plane=PlaneXY(0, 0, 0),
    SizeX=Slider(20, range=0..30),
    SizeY=Slider(17, range=0..30),
    ExtentX=Slider(25, range=0..100),
    ExtentY=Slider(12, range=0..100))  # -> Cells, Points
area_3 = Area(Geometry=recgrid.Cells)  # -> Area, flatten(Centroid)
short = ShortestList(ListA=evalsrf.Frame, ListB=area_3.Centroid, TrimMode=2)  # -> ListA, ListB
orient = Orient(Geometry=merge, Source=evalsrf.Frame, Target=short.ListB)  # -> Geometry, Transform

lng = ListLength(List=merge)
series = Series(Start=0, Step=1, Count=lng)
concat = Concatenate(FragmentA="A", FragmentB=series)
tag = TextTag3D(Location=evalsrf.Point, Text=concat, Size=Slider(1.4, range=0..10), Justification=7)
tabdist = Slider(1.5, range=0..10)
debrep_4 = DeconstructBrep(Brep=orient.Geometry)  # -> Faces, Edges, Vertices
cull_i = CullIndex(List=debrep_4.Edges, Indices="3", Wrap=True)  # -> graft(List)
item_2 = ListItem(List=debrep_4.Edges, Index="3", Wrap=True)
offset = OffsetCurve(Curve=cull_i, Distance=tabdist, Plane=PlaneXY(0, 0, 0), Corners=1)
md_slider_2 = MDSlider(
    SliderMode=0,
    slider_value=Point(0.1500396729, 0.07101559639, 0.5),
    x_domain=Domain(0, 1),
    y_domain=Domain(0, 1),
    z_domain=Domain(0, 1))
subtraction = Subtraction(A="1", B="0.25")
subtraction_2 = Subtraction(A="1", B="0.25")
evalsrf_2 = EvaluateSurface(Surface=reparameterize(debrep_4.Faces), Point=md_slider_2)  # -> flatten(Point), Normal, UDirection, VDirection, Frame
eval = EvaluateCurve(Curve=reparameterize(cull_i), Parameter="0.25")  # -> Point, Tangent, Angle
eval_2 = EvaluateCurve(Curve=reparameterize(cull_i), Parameter=subtraction)  # -> Point, Tangent, Angle
eval_3 = EvaluateCurve(Curve=reparameterize(offset), Parameter="0.25")  # -> Point, Tangent, Angle
eval_4 = EvaluateCurve(Curve=reparameterize(offset), Parameter=subtraction_2)  # -> Point, Tangent, Angle
end = EndPoints(Curve=cull_i)  # -> Start, End
tag_2 = TextTag3D(Location=evalsrf_2.Point, Text=concat, Size=Slider(0.8, range=0..10), Justification=7)
merge_2 = Merge(
    Data1=simplify(end.Start),
    Data2=simplify(eval.Point),
    Data3=simplify(eval_3.Point),
    Data4=simplify(eval_4.Point),
    Data5=simplify(eval_2.Point),
    Data6=simplify(end.End))
ln = Line(StartPoint=eval.Point, EndPoint=eval_2.Point)
pline = PolyLine(Vertices=merge_2, Closed=False)
cut = Curve([pline, item_2])
fold = Curve(ln)
preview = CustomPreview(Geometry=cut, Material=ColourSwatch(SwatchColor=RGB(89, 0, 255)))
preview_2 = CustomPreview(Geometry=fold, Material=ColourSwatch(SwatchColor=RGB(255, 238, 0)))
