# Grasshopper definition f.2.1.0_attractor definition.gh (Grasshopper 0.9.76)

# F.2.1.0
# Attractor Definition
cell_radius = Slider(0.5, range=0..1)
of_cells = Slider(10, range=0..10)
pt = Point([Point(1, 2, 2.476115614), Point(6, 5, 1), Point(2, 8, -1), Point(5, 1, -1)])

# ---- group: Attractor Point
# Click to enable the gumball
# and move the attractor point
pt_2 = Point(Point(1.429829279, 1.68950424, 2.684657556))

# ----
hexgrid = Hexagonal(Plane=PlaneXY(0, 0, 0), Size=cell_radius, ExtentX=of_cells, ExtentY=of_cells)  # -> Cells, Points
offset_distance = Slider(-0.176, range=-0.5..0.5)
# Adjust circle size
cp = ClosestPoint(Point=hexgrid.Points, Cloud=pt)  # -> ClosestPoint, CPIndex, Distance
pcharge = PointCharge(Point=pt, Charge=1, Decay=2)
mergef = MergeFields(Fields=pcharge)
vec2pt = Vector2Pt(PointA=hexgrid.Points, PointB=pt_2, Unitize=False)  # -> Vector, Length
vec2pt_2 = Vector2Pt(PointA=hexgrid.Points, PointB=cp.ClosestPoint, Unitize=False)  # -> Vector, Length
evf = EvaluateField(Field=mergef, Point=hexgrid.Points)  # -> Tensor, Strength
multiplication = Multiplication(A=vec2pt_2.Vector, B=Slider(1.8, range=0..10))
div = DivideDomain(Domain="0.0 to 1.0", Count=of_cells)
circle = CircleCNR(Center=hexgrid.Points, Normal=multiplication, Radius=cell_radius)
vdis = VectorDisplay(Anchor=hexgrid.Points, Vector=multiplication)
dedomain = DeconstructDomain(Domain=div)  # -> Start, End
offset = Offset(Curve=circle, Distance=offset_distance, Plane=PlaneXY(0, 0, 0), Corners=1)
hsl = ColourHSL(Alpha=1, Hue=dedomain.Start, Saturation=1, Luminance=0.5)  # -> graft(Colour)
crv = Curve(hexgrid.Cells)
boundary = BoundarySurfaces(Edges=offset)
pshift = ShiftPaths(Data=boundary, Offset=-1)
preview = CustomPreview(Geometry=pshift, Shader=hsl)
